# Dynamo graph DOB_Regular_Altura_da_Caixa.dyn (Dynamo 2.0.2.6826)

TUBO = DSModelElementSelection()  # nothing selected; graph input
CAIXA = DSModelElementSelection()  # nothing selected; graph input
nome_do_parâmetro = StringInput("Altura do Corpo da Caixa _ maior 41.62mm")  # graph input
new_pipe = Python(IN[0]=TUBO, IN[1]=CAIXA, IN[2]=nome_do_parâmetro)
# ---------- new_pipe.python (82 lines) ----------
"""
Canal De olho no Bim
https://www.youtube.com/watch?v=9TFK43Z9Tbk 
"""

# Ativar suporte de Python e carregar biblioteca DesignScript
import clr
import math
import sys
pyt_path = r'C:\Program Files (x86)\IronPython 2.7\Lib'
sys.path.append (pyt_path)
import System
clr.AddReference ('RevitServices')
import RevitServices
from RevitServices.Persistence import DocumentManager
doc = DocumentManager.Instance.CurrentDBDocument
clr.AddReference ('RevitAPI')
import Autodesk
from Autodesk.Revit.DB import *
clr.AddReference ('RevitNodes')
import Revit
clr.ImportExtensions (Revit.Elements)
clr.ImportExtensions (Revit.GeometryConversion)
import collections
clr.AddReference('ProtoGeometry')
from Autodesk.DesignScript.Geometry import *

# OBTER O PONTO DE MAIOR Z E DE MENOR Z
line = IN[0].GetLocation()
pa = line.StartPoint
pb = line.EndPoint

pini = pa if pa.Z > pb.Z else pb
pfim = pb if pa.Z > pb.Z else pa

# OBTENDO O PONTO DO CONECTOR MAIS PRÓXIMO DO pfim
caixa = IN[1]
ele = UnwrapElement(caixa)
con = ele.MEPModel.ConnectorManager.Connectors
pontos = [i.Origin.ToPoint() for i in con]

aux = {}

for i in pontos:
	aux[Geometry.DistanceTo(pfim,i)] = i
ponto = aux[min(aux.keys())]

# OBTENDO A RETA DO NOVO TUBO
try:
	t = (ponto.X-pini.X)/(pfim.X-pini.X)
except:
	t = (ponto.Y-pini.Y)/(pfim.Y-pini.Y)
pz = pini.Z + t*(pfim.Z-pini.Z)
ponto_final = Point.ByCoordinates(ponto.X,ponto.Y,pz)
new_line = Line.ByStartPointEndPoint(pini,ponto_final)

# OBTENDO A DIFERENÇA DA COTA Z ENTRE O CONECTOR E O TUBO
acres = abs(abs(ponto.Z) - abs(ponto_final.Z))
if ponto.Z < ponto_final.Z:
	acres = -acres
	

# AJUSTANDO ALTURA DA CAIXA
valor = IN[1].GetParameterValueByName(IN[2])
valor += acres 
IN[1].SetParameterByName(IN[2],valor)

# AJUSTANDO O TUBO
#IN[0].SetLocation(new_line)

# CONECTANDO O TUBO A CAIXA
pipe = UnwrapElement(IN[0])
pipec = pipe.ConnectorManager.Connectors
for i in pipec:
	if not i.IsConnected:
		for k in con:
			pcon = k.Origin.ToPoint()
			cx = pcon.X
			cy = pcon.Y
			if cx == ponto.X and cy == ponto.Y:
				i.ConnectTo(k)
OUT = IN[0]
# ----------------------------------------
